# Grasshopper definition apr11_reduce.gh (Grasshopper 0.9.76)
# plug-ins: Python Interpreter, Colibri, TT Toolbox, ExcelReadWrite

# ----
# Rhino Units MUST BE SET TO METERS
toggle = BooleanToggle(True)
updatehoneybee = Honeybee_UpdateHoneybee(updateAllUObjects=Toggle(True))  # -> readMe; plug-in component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
ladybug = Ladybug_Ladybug()  # -> Vviiiiiiiiiizzz; plug-in component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
honeybee = Honeybee_Honeybee()  # -> Vviiiiiiiiiizzz; plug-in component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
# building total ventilated volume
# building height (m)
# gross floor area (m2)
# roof area (m2)
# below grade
# EPC Result
# north east window
# east window
# Window AREA SORTER
# south east window
# south window
# south west window
# west window
# west north window
# north window
# north east wall
# east wall
# Wall AREA SORTER
# south  east wall
# south wall
# south west wall
# west wall
# west north wall
# north wall
updateghfile = Ladybug_UpdateFile(update=toggle)  # -> readMe; plug-in component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

# ----
# Option 1: Floor plan
number_slider = Slider(0.8, range=0..1)
srf = Surface(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)
# Option 2: Volume in Rhino
brep = Brep()
# SCALE
scale = Scale(Geometry=srf, Center=Point(0, 0, 0), Factor=number_slider)  # -> Geometry, Transform
rotate_angle = Panel("""0
45
90
135
180""")
number_slider_2 = Slider(15, range=0..15)
# extrusion
number_slider_3 = Slider(0, range=0..100)
iterator = ColibriIterator(Rotate_angle=rotate_angle, ignoreAllWarningMsg=False, RemoteFly=False)  # -> Rotate_angle, Value_N, Genome
# Curve
crv = Curve(<curve referenced from the Rhino model>)
vec = VectorXYZ(XComponent=number_slider_3, YComponent=Slider(0, range=0..100), ZComponent=number_slider_2)  # -> Vector, Length
topoly = CurveToPolyline(Curve=crv, ToleranceDistance=0, ToleranceAngle=0, MinEdge=Slider(1, range=0..10))  # -> Polyline, Segments
extr = Extrude(Base=scale.Geometry, Direction=vec.Vector)
boundary = BoundarySurfaces(Edges=topoly.Polyline)
# rotation
area = Area(Geometry=scale.Geometry)  # -> Area, Centroid
flatten = FlattenTree(Tree=area.Centroid, Path="{0}")
devec = DeconstructVector(Vector=flatten)  # -> XComponent, YComponent, ZComponent
addition = Addition(A=devec.ZComponent, B=Slider(10, range=0..10))
vec_2 = VectorXYZ(XComponent=devec.XComponent, YComponent=devec.YComponent, ZComponent=addition)  # -> Vector, Length
ln = Line(StartPoint=flatten, EndPoint=vec_2.Vector)
rotax = RotateAxis(Geometry=extr, Angle=Slider(50, range=0..100), Axis=ln)  # -> Geometry, Transform
# split into floors
split2floors = Honeybee_SplitBuildingMass2Floors(bldgMasses=rotax.Geometry, bldgsFlr2FlrHeights="@3", runIt=Toggle(True))  # -> readMe, flatten(splitBldgFloors); plug-in component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
preview = CustomPreview(
    Geometry=split2floors.splitBldgFloors,
    Shader={ambient=RGB(0, 0, 0), diffuse=RGB(255, 105, 180), emission=RGB(76, 32, 54), shine=0.5, specular=RGB(255, 255, 255), transparency=0})
mass2zone = Honeybee_Masses2Zones(zoneMasses=flatten(split2floors.splitBldgFloors), maxRoofAngle=30, createHBZones=Toggle(True))  # -> readMe, HBZones; plug-in component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
number_slider_4 = Slider(0.1, range=0..1)
number_slider_5 = Slider(0.1, range=0..1)
merge = Merge(
    Data1=Slider(0.1, range=0..1),
    Data2=Slider(0.2, range=0..1),
    Data3=Slider(0.5, range=0..1),
    Data4=Slider(0.6, range=0..1))
glazingcreator = Honeybee_GlazingBasedOnRatio(HBObjects=mass2zone.HBZones, glzRatio=merge, runIt=Toggle(True))  # -> readMe, HBObjWGLZ; plug-in component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
toggle_2 = BooleanToggle(True)
solveadjc = Honeybee_SolveAdjacencies(HBZones=flatten(glazingcreator.HBObjWGLZ), removeCurrentAdjc=toggle_2, findAdjc=toggle_2)  # -> readMe, HBZonesWADJ; plug-in component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
decomposebytype = Honeybee_DecomposeBasedOnType(HBZone=solveadjc.HBZonesWADJ)  # -> walls, interiorWalls, airWalls, windows, interiorWindows, skylights, roofs, ceilings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; plug-in component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
flatten_2 = FlattenTree(Tree=decomposebytype.walls, Path="{0}")
point = Point(Point(-41.37035602, 6.02479444, 0))
# NORTH DIRECTION
point_2 = Point(Point(-41.37035602, -14.94598175, 0))
window_surfaces = Surface(decomposebytype.windows)
below_grade_opaque = Surface(decomposebytype.undergroundWalls)
wall_surfaces = Surface(flatten_2)
floor_surfaces = Surface([decomposebytype.floors, decomposebytype.groundFloors])
roof_surfaces = Surface(decomposebytype.roofs)
skylight_surfaces = Surface(decomposebytype.skylights)
context = Brep(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)
vector_2pt = Vector2Pt(PointA=point_2, PointB=point, Unitize=False)  # -> Vector, Length
# true to run sunlight analysis
run = BooleanToggle(True)
preview_2 = CustomPreview(Geometry=context, Shader=ColourSwatch(SwatchColor=RGB(186, 191, 168)))
volume = Volume(Geometry=split2floors.splitBldgFloors)  # -> Volume, Centroid
# SUNPATH
open_weather_file = Ladybug_OpenEPWWeatherFile(open=Toggle(True))  # -> epwFile; plug-in component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
area_2 = Area(Geometry=window_surfaces)  # -> Area, Centroid
evaluate_surface = EvaluateSurface(Surface=window_surfaces, Point=area_2.Centroid)  # -> Point, Normal, Frame
angle = Angle(VectorA=evaluate_surface.Normal, VectorB=vector_2pt.Vector, Plane=PlaneXY(0, 0, 0))  # -> Angle, Reflex
area_3 = Area(Geometry=wall_surfaces)  # -> Area, Centroid
evaluate_surface_2 = EvaluateSurface(Surface=wall_surfaces, Point=area_3.Centroid)  # -> Point, Normal, Frame
angle_2 = Angle(VectorA=evaluate_surface_2.Normal, VectorB=vector_2pt.Vector, Plane=PlaneXY(0, 0, 0))  # -> Angle, Reflex
ma = MassAddition(Input=volume.Volume)  # -> Result, PartialResults
area_4 = Area(Geometry=roof_surfaces)  # -> Area, Centroid
degrees = Degrees(Radians=angle.Angle)
area_5 = Area(Geometry=floor_surfaces)  # -> Area, Centroid
area_6 = Area(Geometry=below_grade_opaque)  # -> Area, Centroid
area_7 = Area(Geometry=[below_grade_opaque, skylight_surfaces])  # -> Area, Centroid
degrees_2 = Degrees(Radians=angle_2.Angle)
flatten_3 = FlattenTree(Tree=area_2.Area, Path="{0}")
flatten_4 = FlattenTree(Tree=degrees, Path="{0}")
flatten_5 = FlattenTree(Tree=area_6.Area, Path="{0}")
flatten_6 = FlattenTree(Tree=area_4.Area, Path="{0}")

importepw = Ladybug_ImportEpw(epwFile=open_weather_file)  # -> readMe, latitude, location, dryBulbTemperature, dewPointTemperature, relativeHumidity, windSpeed, windDirection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; plug-in component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

flatten_7 = FlattenTree(Tree=area_7.Area, Path="{0}")
flatten_8 = FlattenTree(Tree=area_5.Area, Path="{0}")
number = Number(flatten_3)
number_2 = Number(area_3.Area)
number_3 = Number(flatten_4)
number_4 = Number(degrees_2)
mass_addition = MassAddition(Input=flatten_5)  # -> Result, PartialResults
mass_addition_2 = MassAddition(Input=flatten_6)  # -> Result, PartialResults
mass_addition_3 = MassAddition(Input=flatten_8)  # -> Result, PartialResults
mass_addition_4 = MassAddition(Input=flatten_7)  # -> Result, PartialResults
analysisperiod = Ladybug_AnalysisPeriod()  # -> readMe, analysisPeriod; plug-in component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
cluster = Cluster(
    L_3=number,
    A=number_3,
    L=number_3,
    L_5=number,
    A_2=number_3,
    L_2=number_3,
    L_6=number,
    A_3=number_3,
    L_4=number_3,
    L_9=number,
    A_4=number_3,
    L_7=number_3,
    L_10=number,
    A_5=number_3,
    L_8=number_3,
    L_12=number,
    A_6=number_3,
    L_11=number_3,
    L_16=number,
    A_8=number_3,
    L_14=number_3,
    L_15=number,
    A_7=number_3,
    L_13=number_3,
    L_18=number,
    A_9=number_3,
    L_17=number_3)  # -> L_19, L_20, L_21, L_22, L_23, L_24, L_26, L_25, L_27
sunpathscale = Slider(0.5, range=0..10)
cluster_2 = Cluster(
    L_3=number_2,
    A=number_4,
    L=number_4,
    L_5=number_2,
    A_2=number_4,
    L_2=number_4,
    L_6=number_2,
    A_3=number_4,
    L_4=number_4,
    L_9=number_2,
    A_4=number_4,
    L_7=number_4,
    L_10=number_2,
    A_5=number_4,
    L_8=number_4,
    L_12=number_2,
    A_6=number_4,
    L_11=number_4,
    L_16=number_2,
    A_8=number_4,
    L_14=number_4,
    L_15=number_2,
    A_7=number_4,
    L_13=number_4,
    L_18=number_2,
    A_9=number_4,
    L_17=number_4)  # -> L_19, L_20, L_21, L_22, L_23, L_24, L_26, L_25, L_27
ma_2 = MassAddition(Input=cluster.L_19)  # -> Result, PartialResults
ma_3 = MassAddition(Input=cluster.L_20)  # -> Result, PartialResults
ma_4 = MassAddition(Input=cluster.L_21)  # -> Result, PartialResults
ma_5 = MassAddition(Input=cluster.L_22)  # -> Result, PartialResults
ma_6 = MassAddition(Input=cluster.L_23)  # -> Result, PartialResults
ma_7 = MassAddition(Input=cluster.L_24)  # -> Result, PartialResults
ma_8 = MassAddition(Input=cluster.L_26)  # -> Result, PartialResults
ma_9 = MassAddition(Input=[cluster.L_25, cluster.L_27])  # -> Result, PartialResults
ma_10 = MassAddition(Input=cluster_2.L_19)  # -> Result, PartialResults
ma_11 = MassAddition(Input=cluster_2.L_20)  # -> Result, PartialResults
ma_12 = MassAddition(Input=cluster_2.L_21)  # -> Result, PartialResults
ma_13 = MassAddition(Input=cluster_2.L_22)  # -> Result, PartialResults
ma_14 = MassAddition(Input=cluster_2.L_23)  # -> Result, PartialResults
ma_15 = MassAddition(Input=cluster_2.L_24)  # -> Result, PartialResults
ma_16 = MassAddition(Input=cluster_2.L_26)  # -> Result, PartialResults
ma_17 = MassAddition(Input=[cluster_2.L_25, cluster_2.L_27])  # -> Result, PartialResults
# north east window
panel = Panel(ma_2.Result)
# east window
panel_2 = Panel(ma_3.Result)
# south window
panel_3 = Panel(ma_5.Result)
# south west window
panel_4 = Panel(ma_6.Result)
# west window
panel_5 = Panel(ma_7.Result)
# west north window
panel_6 = Panel(ma_8.Result)
# east wall
panel_7 = Panel(ma_11.Result)
# south  east wall
panel_8 = Panel(ma_12.Result)
# south west wall
panel_9 = Panel(ma_14.Result)
# west north wall
panel_10 = Panel(ma_16.Result)
# north wall
panel_11 = Panel(ma_17.Result)
# south east window
panel_12 = Panel(ma_4.Result)
# north window
panel_13 = Panel(ma_9.Result)
# north east wall
panel_14 = Panel(ma_10.Result)
# south wall
panel_15 = Panel(ma_13.Result)
# west wall
panel_16 = Panel(ma_15.Result)
series = Series(Start=1, Step=1, Count=12)
series_2 = Series(Start=1, Step=1, Count=24)
# building total ventilated volume
# building height (m)
panel_17 = Panel(ma.Result)
panel_18 = Panel(number_slider_2)
# gross floor area (m2)
panel_19 = Panel(mass_addition_3.Result)
# below grade
panel_20 = Panel(mass_addition.Result)
# roof area (m2)
panel_21 = Panel(mass_addition_2.Result)
# skylight area (m2)
panel_22 = Panel(mass_addition_4.Result)

# ---- group: There is a change in input or output. Replace manually with the inserted component!
sunpath = Ladybug_SunPath(
    north=vector_2pt.Vector,
    location=importepw.location,
    hour=series_2,
    day=Slider(15, range=0..100),
    month=graft(series),
    timeStep=1,
    sunPathScale=sunpathscale,
    dailyOrAnnualSunPath=True)  # -> readMe, sunVectors, sunAltitudes, sunAzimuths, port, sunSpheresMesh, sunPathCrvs, compassCrvs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; plug-in component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

# ----
sunpath_2 = Ladybug_SunPath(hour=12, day=21, month=12, timeStep=1, dailyOrAnnualSunPath=True)  # -> readMe, sunVectors, sunAltitudes, sunAzimuths, port, sunSpheresMesh, sunPathCrvs, compassCrvs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; plug-in component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
sunpath_3 = Ladybug_SunPath(hour=12, day=21, month=12, timeStep=1, dailyOrAnnualSunPath=True)  # -> readMe, sunVectors, sunAltitudes, sunAzimuths, port, sunSpheresMesh, sunPathCrvs, compassCrvs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; plug-in component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
cluster_3 = Cluster_2(
    context_7=context,
    L=window_surfaces,
    sunvectors_7=sunpath.sunVectors,
    context_5=context,
    sunvectors_2=sunpath.sunVectors,
    runit_7=run,
    L_16=sunpath.sunVectors,
    geometry=window_surfaces,
    L_12=sunpath.sunVectors,
    L_2=window_surfaces,
    runit_5=run,
    surface=window_surfaces,
    context_2=context,
    L_3=window_surfaces,
    context_9=context,
    vector_b=vector_2pt.Vector,
    sunvectors_3=sunpath.sunVectors,
    sunvectors_9=sunpath.sunVectors,
    runit_2=run,
    L_4=window_surfaces,
    runit_9=run,
    L_11=sunpath.sunVectors,
    L_18=sunpath.sunVectors,
    context_4=context,
    L_5=window_surfaces,
    context_10=context,
    sunvectors_5=sunpath.sunVectors,
    sunvectors_10=sunpath.sunVectors,
    runit_4=run,
    L_6=window_surfaces,
    runit_10=run,
    L_14=sunpath.sunVectors,
    L_19=sunpath.sunVectors,
    context_3=context,
    L_7=window_surfaces,
    sunvectors_4=sunpath.sunVectors,
    context_8=context,
    sunvectors_8=sunpath.sunVectors,
    runit_3=run,
    L_8=window_surfaces,
    L_13=sunpath.sunVectors,
    runit_8=run,
    L_17=sunpath.sunVectors,
    L_9=window_surfaces,
    geometry_2=skylight_surfaces,
    context_6=context,
    sunvectors_6=sunpath.sunVectors,
    runit_6=run,
    L_15=sunpath.sunVectors)  # -> r, r_3, r_7, r_2, r_9, r_4, r_10, r_5, r_8, r_6
# east window
panel_23 = Panel(cluster_3.r_2)
# south east window
panel_24 = Panel(cluster_3.r_4)
# south window
panel_25 = Panel(cluster_3.r_5)
# south west window
panel_26 = Panel(cluster_3.r_7)
# west north window
panel_27 = Panel(cluster_3.r_10)
# north window
# ROOF
panel_28 = Panel(cluster_3.r_8)
# SRF
# north east window
panel_29 = Panel(cluster_3.r_3)
panel_30 = Panel(cluster_3.r_6)
# west window
panel_31 = Panel(cluster_3.r_9)
data = Data([panel_17, panel_18, panel_19, panel_21, panel_20, panel_22])
data_2 = Data([panel_3, panel_12, panel_2, panel, panel_13, panel_6, panel_5, panel_4])
data_3 = Data([panel_15, panel_8, panel_7, panel_14, panel_11, panel_10, panel_16, panel_9])
jan_srf = Data([panel_25, panel_24, panel_23, panel_29, panel_30, panel_28, panel_27, panel_31, panel_26])
srf_2 = Panel(jan_srf)
data_4 = Data(srf_2)
data_5 = Data([data, data_2, data_3, data_4])
path = FilePath("I:\GT\rA\ra\Apr12_lab\apr_12_reduce.xlsb")
wo = WriteOptions(
    FilePath=path,
    ClearDataOverwrite=False,
    SaveAfterWrite=True,
    CloseAfterWrite=Toggle(True),
    ColumnStartPosition=2,
    RowStartPosition=2)  # -> UserMessages, WriteOptions
# 2
toggle_3 = BooleanToggle(True)
writexl = WriteToExcel(Run=toggle_3, ExcelWorksheet="3", WriteOptions=wo.WriteOptions, ColumnnsOrRows=False, DataToWriteIntoColumns=data_5)
# 1
toggle_4 = BooleanToggle(True)
exdread = ExcelDynamicRead(ExcelFile=path, Connect=toggle_4, Sheet1="C5:C7")  # -> Message, Stats, graft(RESULT)
panel_32 = Panel(exdread.RESULT)
bang = ExplodeTree(Data=panel_32)  # -> Branch0, Branch1, Branch2
addition_2 = Addition(A=bang.Branch0, B=bang.Branch1)
# Reference value battery needed
delivered_energy = Panel(bang.Branch2)
energy_need = Panel(addition_2)
division = Division(A=energy_need, B=Slider(100, range=0..100))
division_2 = Division(A=delivered_energy, B=Slider(100, range=0..100))
concat = Concatenate(FragmentA="epc1:", FragmentC=division, FragmentB="epc2:", FragmentD=division_2)
gradient = Gradient(
    LowerLimit=Slider(0, range=0..100),
    UpperLimit=Slider(2, range=0..10),
    Parameter=division,
    stops=[0: RGB(0, 128, 0), 0.5: RGB(255, 255, 0), 1: RGB(255, 0, 0)])
tag = TextTag3D(Location=area_4.Centroid, Text=concat, Size=Slider(2, range=0..10), Justification=7)
parameters = ColibriParameters()  # disabled
preview_3 = CustomPreview(Geometry=roof_surfaces, Shader=gradient)
panel_33 = Panel("I:\GT\rA\ra\3.28\srf+ori+no_month_iter\")  # disabled
panel_34 = Panel("data.csv")  # disabled
toggle_5 = BooleanToggle(False)  # disabled
concat_2 = Concatenate(FragmentA=panel_33, FragmentB=panel_34)  # disabled
aggregator = ColibriAggregator(Folder=panel_33, IterationGenomeID=iterator.Genome, IterationPhenomeResults=parameters, Write=toggle_5, recordingMode=3)  # disabled
path_2 = FilePath(concat_2)  # disabled
panel_35 = Panel("data")  # disabled
toggle_6 = BooleanToggle(True)  # disabled
toggle_7 = BooleanToggle(True)  # disabled
readxl = ReadExcelSheet(Run=toggle_6, FilePath=path_2, Worksheet=panel_35, Listen=toggle_7)  # -> UserMessages, Columns, Rows; disabled
split2zone = Honeybee_SplitFloor2ThermalZones()  # -> readMe, splitBldgZones; plug-in component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
createhbzones = Honeybee_createHBZones(isConditioned=True)  # -> readMe, HBZone; plug-in component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
brep_2 = Brep(<brep referenced from the Rhino model>)
brep_3 = Brep(<brep referenced from the Rhino model>)
createhbsrfs = Honeybee_createHBSrfs(geometry=brep_2, srfType=Slider(0, range=0..100))  # -> readMe, simplify(HBSurface); plug-in component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
brep_4 = Brep(<brep referenced from the Rhino model>)
createhbsrfs_2 = Honeybee_createHBSrfs(geometry=brep_3, srfType=Slider(5, range=0..10))  # -> readMe, simplify(HBSurface); plug-in component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
solveadjc_2 = Honeybee_SolveAdjacencies(HBZones=flatten(createhbzones.HBZone), removeCurrentAdjc=False)  # -> readMe, HBZonesWADJ; plug-in component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
brep_5 = Brep([createhbsrfs.HBSurface, createhbsrfs_2.HBSurface])
mass2zone_2 = Honeybee_Masses2Zones(zoneMasses=flatten(brep_2), maxRoofAngle=30, createHBZones=Toggle(True))  # -> readMe, HBZones; plug-in component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
createhbzones_2 = Honeybee_createHBZones(HBSurfaces=flatten([createhbsrfs.HBSurface, createhbsrfs_2.HBSurface]), isConditioned=Toggle(True))  # -> readMe, HBZone; plug-in component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
glzparamlist = Honeybee_GlazingParametersList(northGlzParam=0, westGlzParam=0, southGlzParam=0, eastGlzParam=0)  # -> glzParamList; plug-in component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
glazingcreator_2 = Honeybee_GlazingBasedOnRatio(HBObjects=mass2zone_2.HBZones, glzRatio=Slider(0.2, range=0..1), runIt=Toggle(True))  # -> readMe, HBObjWGLZ; plug-in component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
rotatehbobj = Honeybee_RotateHoneybee(HBObj=flatten(mass2zone_2.HBZones), angle=Slider(16, range=0..100))  # -> HBObj; disabled; plug-in component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
addhbglz = Honeybee_addHBGlz(HBObj=mass2zone_2.HBZones, childSurfaces=flatten(brep_3))  # -> HBObjWGLZ; plug-in component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
selbytype = Honeybee_SelectByType(HBZones=mass2zone_2.HBZones, showWindows=Toggle(True))  # -> surfaces, flatten(HBSurfaces); plug-in component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
rdiff = RegionDifference()
area_8 = Area(Geometry=selbytype.HBSurfaces)  # -> Area, Centroid
panel_36 = Panel(area_8.Area)
srfviewfactors = Ladybug_SurfaceViewAnalysis()  # -> readMe, srfViewFactors, viewVecSrfIndex, viewVectors, viewPatches, viewPatchBasePt; plug-in component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

# ==== cluster Cluster
A = ClusterInput()
A_2 = ClusterInput()
A_3 = ClusterInput()
A_4 = ClusterInput()
A_5 = ClusterInput()
A_6 = ClusterInput()
A_7 = ClusterInput()
A_8 = ClusterInput()
A_9 = ClusterInput()
L = ClusterInput()
L_2 = ClusterInput()
L_3 = ClusterInput()

larger = LargerThan(FirstNumber=A, SecondNumber="22.5")  # -> LargerThan, OrEqualTo
cull = CullPattern(List=L, CullPattern=larger.LargerThan)
cull_2 = CullPattern(List=L_3, CullPattern=larger.LargerThan)
smaller = SmallerThan(FirstNumber=cull, SecondNumber="67.5")  # -> SmallerThan, OrEqualTo
cull_3 = CullPattern(List=cull_2, CullPattern=smaller.OrEqualTo)

L_4 = ClusterInput()
L_5 = ClusterInput()

larger_2 = LargerThan(FirstNumber=A_2, SecondNumber="67.5")  # -> LargerThan, OrEqualTo
cull_4 = CullPattern(List=L_2, CullPattern=larger_2.LargerThan)
cull_5 = CullPattern(List=L_5, CullPattern=larger_2.LargerThan)
smaller_2 = SmallerThan(FirstNumber=cull_4, SecondNumber="112.5")  # -> SmallerThan, OrEqualTo
cull_6 = CullPattern(List=cull_5, CullPattern=smaller_2.OrEqualTo)

L_6 = ClusterInput()

larger_3 = LargerThan(FirstNumber=A_3, SecondNumber="112.5")  # -> LargerThan, OrEqualTo
cull_7 = CullPattern(List=L_4, CullPattern=larger_3.LargerThan)
cull_8 = CullPattern(List=L_6, CullPattern=larger_3.LargerThan)
smaller_3 = SmallerThan(FirstNumber=cull_7, SecondNumber="157.5")  # -> SmallerThan, OrEqualTo
cull_9 = CullPattern(List=cull_8, CullPattern=smaller_3.OrEqualTo)

L_7 = ClusterInput()
L_8 = ClusterInput()
L_9 = ClusterInput()

larger_4 = LargerThan(FirstNumber=A_4, SecondNumber="157.5")  # -> LargerThan, OrEqualTo
cull_10 = CullPattern(List=L_7, CullPattern=larger_4.LargerThan)
cull_11 = CullPattern(List=L_9, CullPattern=larger_4.LargerThan)
smaller_4 = SmallerThan(FirstNumber=cull_10, SecondNumber="202.5")  # -> SmallerThan, OrEqualTo
cull_12 = CullPattern(List=cull_11, CullPattern=smaller_4.OrEqualTo)

L_10 = ClusterInput()

larger_5 = LargerThan(FirstNumber=A_5, SecondNumber="202.5")  # -> LargerThan, OrEqualTo
cull_13 = CullPattern(List=L_8, CullPattern=larger_5.LargerThan)
cull_14 = CullPattern(List=L_10, CullPattern=larger_5.LargerThan)
smaller_5 = SmallerThan(FirstNumber=cull_13, SecondNumber="247.5")  # -> SmallerThan, OrEqualTo
cull_15 = CullPattern(List=cull_14, CullPattern=smaller_5.OrEqualTo)

L_11 = ClusterInput()
L_12 = ClusterInput()

larger_6 = LargerThan(FirstNumber=A_6, SecondNumber="247.5")  # -> LargerThan, OrEqualTo
cull_16 = CullPattern(List=L_11, CullPattern=larger_6.LargerThan)
cull_17 = CullPattern(List=L_12, CullPattern=larger_6.LargerThan)
smaller_6 = SmallerThan(FirstNumber=cull_16, SecondNumber="292.5")  # -> SmallerThan, OrEqualTo
cull_18 = CullPattern(List=cull_17, CullPattern=smaller_6.OrEqualTo)

L_13 = ClusterInput()
L_14 = ClusterInput()
L_15 = ClusterInput()
L_16 = ClusterInput()

larger_7 = LargerThan(FirstNumber=A_8, SecondNumber="292.5")  # -> LargerThan, OrEqualTo
cull_19 = CullPattern(List=L_14, CullPattern=larger_7.LargerThan)
cull_20 = CullPattern(List=L_16, CullPattern=larger_7.LargerThan)
smaller_7 = SmallerThan(FirstNumber=cull_19, SecondNumber="337.5")  # -> SmallerThan, OrEqualTo
cull_21 = CullPattern(List=cull_20, CullPattern=smaller_7.OrEqualTo)

L_17 = ClusterInput()
L_18 = ClusterInput()

larger_8 = LargerThan(FirstNumber=A_7, SecondNumber="337.5")  # -> LargerThan, OrEqualTo
larger_9 = LargerThan(FirstNumber=A_9, SecondNumber="0")  # -> LargerThan, OrEqualTo
cull_22 = CullPattern(List=L_13, CullPattern=larger_8.LargerThan)
cull_23 = CullPattern(List=L_15, CullPattern=larger_8.LargerThan)
cull_24 = CullPattern(List=L_17, CullPattern=larger_9.OrEqualTo)
cull_25 = CullPattern(List=L_18, CullPattern=larger_9.OrEqualTo)
smaller_8 = SmallerThan(FirstNumber=cull_22, SecondNumber="360")  # -> SmallerThan, OrEqualTo
smaller_9 = SmallerThan(FirstNumber=cull_24, SecondNumber="22.5")  # -> SmallerThan, OrEqualTo
cull_26 = CullPattern(List=cull_23, CullPattern=smaller_8.OrEqualTo)
cull_27 = CullPattern(List=cull_25, CullPattern=smaller_9.OrEqualTo)

L_19 = ClusterOutput(cull_3)
L_20 = ClusterOutput(cull_6)
L_21 = ClusterOutput(cull_9)
L_22 = ClusterOutput(cull_12)
L_23 = ClusterOutput(cull_15)
L_24 = ClusterOutput(cull_18)
L_25 = ClusterOutput(cull_26)
L_26 = ClusterOutput(cull_21)
L_27 = ClusterOutput(cull_27)

# ==== cluster Cluster_2
geometry = ClusterInput()
vector_b = ClusterInput()
surface = ClusterInput()
area = Area(Geometry=geometry)  # -> Area, Centroid
evaluate_surface = EvaluateSurface(Surface=surface, Point=area.Centroid)  # -> Point, Normal, Frame
angle = Angle(VectorA=evaluate_surface.Normal, VectorB=vector_b, Plane=PlaneXY(0, 0, 0))  # -> Angle, Reflex
degrees = Degrees(Radians=angle.Angle)
number = Number(area.Area)
number_2 = Number(degrees)

# ----
# north east window
panel = Panel("22.5")
larger = LargerThan(FirstNumber=number_2, SecondNumber=panel)  # -> LargerThan, OrEqualTo
cull = CullPattern(List=number_2, CullPattern=larger.LargerThan)
cull_2 = CullPattern(List=number, CullPattern=larger.LargerThan)
smaller = SmallerThan(FirstNumber=cull, SecondNumber="67.5")  # -> SmallerThan, OrEqualTo
cull_3 = CullPattern(List=cull_2, CullPattern=smaller.OrEqualTo)
ma = MassAddition(Input=cull_3)  # -> Result, PartialResults
panel_2 = Panel(ma.Result)

# ----
# east window
panel_3 = Panel("67.5")
larger_2 = LargerThan(FirstNumber=number_2, SecondNumber=panel_3)  # -> LargerThan, OrEqualTo
cull_4 = CullPattern(List=number_2, CullPattern=larger_2.LargerThan)
cull_5 = CullPattern(List=number, CullPattern=larger_2.LargerThan)
smaller_2 = SmallerThan(FirstNumber=cull_4, SecondNumber="112.5")  # -> SmallerThan, OrEqualTo
cull_6 = CullPattern(List=cull_5, CullPattern=smaller_2.OrEqualTo)
ma_2 = MassAddition(Input=cull_6)  # -> Result, PartialResults
panel_4 = Panel(ma_2.Result)

# ----
# south east window
panel_5 = Panel("112.5")
larger_3 = LargerThan(FirstNumber=number_2, SecondNumber=panel_5)  # -> LargerThan, OrEqualTo
cull_7 = CullPattern(List=number_2, CullPattern=larger_3.LargerThan)
cull_8 = CullPattern(List=number, CullPattern=larger_3.LargerThan)
smaller_3 = SmallerThan(FirstNumber=cull_7, SecondNumber="157.5")  # -> SmallerThan, OrEqualTo
cull_9 = CullPattern(List=cull_8, CullPattern=smaller_3.OrEqualTo)
ma_3 = MassAddition(Input=cull_9)  # -> Result, PartialResults
panel_6 = Panel(ma_3.Result)

# ----
# south window
panel_7 = Panel("157.5")
larger_4 = LargerThan(FirstNumber=number_2, SecondNumber=panel_7)  # -> LargerThan, OrEqualTo
cull_10 = CullPattern(List=number_2, CullPattern=larger_4.LargerThan)
cull_11 = CullPattern(List=number, CullPattern=larger_4.LargerThan)
smaller_4 = SmallerThan(FirstNumber=cull_10, SecondNumber="202.5")  # -> SmallerThan, OrEqualTo
cull_12 = CullPattern(List=cull_11, CullPattern=smaller_4.OrEqualTo)
ma_4 = MassAddition(Input=cull_12)  # -> Result, PartialResults
panel_8 = Panel(ma_4.Result)

# ----
# south west window
panel_9 = Panel("202.5")
larger_5 = LargerThan(FirstNumber=number_2, SecondNumber=panel_9)  # -> LargerThan, OrEqualTo
cull_13 = CullPattern(List=number_2, CullPattern=larger_5.LargerThan)
cull_14 = CullPattern(List=number, CullPattern=larger_5.LargerThan)
smaller_5 = SmallerThan(FirstNumber=cull_13, SecondNumber="247.5")  # -> SmallerThan, OrEqualTo
cull_15 = CullPattern(List=cull_14, CullPattern=smaller_5.OrEqualTo)
ma_5 = MassAddition(Input=cull_15)  # -> Result, PartialResults
panel_10 = Panel(ma_5.Result)

# ----
# west window
panel_11 = Panel("247.5")
larger_6 = LargerThan(FirstNumber=number_2, SecondNumber=panel_11)  # -> LargerThan, OrEqualTo
cull_16 = CullPattern(List=number_2, CullPattern=larger_6.LargerThan)
cull_17 = CullPattern(List=number, CullPattern=larger_6.LargerThan)
smaller_6 = SmallerThan(FirstNumber=cull_16, SecondNumber="292.5")  # -> SmallerThan, OrEqualTo
cull_18 = CullPattern(List=cull_17, CullPattern=smaller_6.OrEqualTo)
ma_6 = MassAddition(Input=cull_18)  # -> Result, PartialResults
panel_12 = Panel(ma_6.Result)

# ----
# west north window
panel_13 = Panel("292.5")
larger_7 = LargerThan(FirstNumber=number_2, SecondNumber=panel_13)  # -> LargerThan, OrEqualTo
cull_19 = CullPattern(List=number_2, CullPattern=larger_7.LargerThan)
cull_20 = CullPattern(List=number, CullPattern=larger_7.LargerThan)
smaller_7 = SmallerThan(FirstNumber=cull_19, SecondNumber="337.5")  # -> SmallerThan, OrEqualTo
cull_21 = CullPattern(List=cull_20, CullPattern=smaller_7.OrEqualTo)
ma_7 = MassAddition(Input=cull_21)  # -> Result, PartialResults
panel_14 = Panel(ma_7.Result)

# ----
# north window
panel_15 = Panel("337.5")
larger_8 = LargerThan(FirstNumber=number_2, SecondNumber=panel_15)  # -> LargerThan, OrEqualTo
larger_9 = LargerThan(FirstNumber=number_2, SecondNumber="0")  # -> LargerThan, OrEqualTo
cull_22 = CullPattern(List=number_2, CullPattern=larger_8.LargerThan)
cull_23 = CullPattern(List=number, CullPattern=larger_8.LargerThan)
cull_24 = CullPattern(List=number_2, CullPattern=larger_9.OrEqualTo)
cull_25 = CullPattern(List=number, CullPattern=larger_9.OrEqualTo)
smaller_8 = SmallerThan(FirstNumber=cull_22, SecondNumber="360")  # -> SmallerThan, OrEqualTo
smaller_9 = SmallerThan(FirstNumber=cull_24, SecondNumber="22.5")  # -> SmallerThan, OrEqualTo
cull_26 = CullPattern(List=cull_23, CullPattern=smaller_8.OrEqualTo)
cull_27 = CullPattern(List=cull_25, CullPattern=smaller_9.OrEqualTo)
ma_8 = MassAddition(Input=[cull_27, cull_26])  # -> Result, PartialResults
panel_16 = Panel(ma_8.Result)

L = ClusterInput()
L_2 = ClusterInput()
L_3 = ClusterInput()
L_4 = ClusterInput()
L_5 = ClusterInput()
L_6 = ClusterInput()
L_7 = ClusterInput()
L_8 = ClusterInput()
L_9 = ClusterInput()
cull_28 = CullPattern(List=L, CullPattern=larger.LargerThan)
cull_29 = CullPattern(List=L_2, CullPattern=larger_2.LargerThan)
cull_30 = CullPattern(List=L_3, CullPattern=larger_3.LargerThan)
cull_31 = CullPattern(List=L_4, CullPattern=larger_4.LargerThan)
cull_32 = CullPattern(List=L_5, CullPattern=larger_5.LargerThan)
cull_33 = CullPattern(List=L_6, CullPattern=larger_6.LargerThan)
cull_34 = CullPattern(List=L_7, CullPattern=larger_7.LargerThan)
cull_35 = CullPattern(List=L_8, CullPattern=larger_8.LargerThan)
cull_36 = CullPattern(List=L_9, CullPattern=larger_9.OrEqualTo)
cull_37 = CullPattern(List=cull_28, CullPattern=smaller.OrEqualTo)
cull_38 = CullPattern(List=cull_29, CullPattern=smaller_2.OrEqualTo)
cull_39 = CullPattern(List=cull_30, CullPattern=smaller_3.OrEqualTo)
cull_40 = CullPattern(List=cull_31, CullPattern=smaller_4.OrEqualTo)
cull_41 = CullPattern(List=cull_32, CullPattern=smaller_5.OrEqualTo)
cull_42 = CullPattern(List=cull_33, CullPattern=smaller_6.OrEqualTo)
cull_43 = CullPattern(List=cull_34, CullPattern=smaller_7.OrEqualTo)
cull_44 = CullPattern(List=cull_35, CullPattern=smaller_8.OrEqualTo)
cull_45 = CullPattern(List=cull_36, CullPattern=smaller_9.OrEqualTo)
brep = Brep(cull_41)
brep_2 = Brep(cull_43)
brep_3 = Brep([cull_45, cull_44])
brep_4 = Brep(cull_37)
brep_5 = Brep(cull_38)
brep_6 = Brep(cull_39)
brep_7 = Brep(cull_40)
brep_8 = Brep(cull_42)
sunvectors = ClusterInput()
context = ClusterInput()
# Sunlight Hour Analysis
# Sunlight Hour Analysis
runit = ClusterInput()
slider = Slider(5, range=0.3..10)
sunlighthoursanalysis = Ladybug_SunlightHoursAnalysis(
    geometry=[brep_4, brep_5],
    context=flatten(context),
    gridSize=Slider(1.9, range=0.3..10),
    disFromBase=Slider(0.1, range=0..1),
    sunVectors=sunvectors,
    timeStep=1,
    runIt=runit)  # -> readMe, contextMesh, analysisMesh, testPts, testVec, port, sunlightHoursResult, sunlightHoursMesh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; plug-in component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
slider_2 = Slider(0.1, range=0..1)
sunvectors_2 = ClusterInput()
context_2 = ClusterInput()
sunvectors_3 = ClusterInput()
runit_2 = ClusterInput()
context_3 = ClusterInput()
sunvectors_4 = ClusterInput()
runit_3 = ClusterInput()
context_4 = ClusterInput()
sunvectors_5 = ClusterInput()
runit_4 = ClusterInput()
context_5 = ClusterInput()
runit_5 = ClusterInput()
L_10 = ClusterInput()
# Sunlight Hour Analysis
sunlighthoursanalysis_2 = Ladybug_SunlightHoursAnalysis(
    geometry=flatten(brep_5),
    context=flatten(context_2),
    gridSize=slider,
    disFromBase=slider_2,
    sunVectors=sunvectors_3,
    timeStep=1,
    runIt=runit_2)  # -> readMe, contextMesh, analysisMesh, testPts, testVec, port, sunlightHoursResult, sunlightHoursMesh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; plug-in component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
flatten = FlattenTree(Tree=sunlighthoursanalysis.sunlightHoursResult, Path="{0}")
sunlighthoursanalysis_3 = Ladybug_SunlightHoursAnalysis(
    geometry=flatten(brep_7),
    context=flatten(context_3),
    gridSize=slider,
    disFromBase=slider_2,
    sunVectors=sunvectors_4,
    timeStep=1,
    runIt=runit_3)  # -> readMe, contextMesh, analysisMesh, testPts, testVec, port, sunlightHoursResult, sunlightHoursMesh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; plug-in component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
# Sunlight Hour Analysis
sunlighthoursanalysis_4 = Ladybug_SunlightHoursAnalysis(
    geometry=flatten(brep_6),
    context=flatten(context_4),
    gridSize=slider,
    disFromBase=slider_2,
    sunVectors=sunvectors_5,
    timeStep=1,
    runIt=runit_4)  # -> readMe, contextMesh, analysisMesh, testPts, testVec, port, sunlightHoursResult, sunlightHoursMesh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; plug-in component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
sunlighthoursanalysis_5 = Ladybug_SunlightHoursAnalysis(
    geometry=flatten(brep_4),
    context=flatten(context_5),
    gridSize=slider,
    disFromBase=slider_2,
    sunVectors=sunvectors_2,
    timeStep=1,
    runIt=runit_5)  # -> readMe, contextMesh, analysisMesh, testPts, testVec, port, sunlightHoursResult, sunlightHoursMesh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; plug-in component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
lng = ListLength(List=flatten(sunlighthoursanalysis.sunlightHoursResult))
lng_2 = ListLength(List=L_10)
ma_9 = MassAddition(Input=flatten)  # -> Result, PartialResults
multiplication = Multiplication(A=lng_2, B=lng)
eval = Evaluate(F="x/y", x=ma_9.Result, y=multiplication)
L_11 = ClusterInput()
L_12 = ClusterInput()
L_13 = ClusterInput()
L_14 = ClusterInput()
flatten_2 = FlattenTree(Tree=sunlighthoursanalysis_2.sunlightHoursResult, Path="{0}")
flatten_3 = FlattenTree(Tree=sunlighthoursanalysis_5.sunlightHoursResult, Path="{0}")
flatten_4 = FlattenTree(Tree=sunlighthoursanalysis_3.sunlightHoursResult, Path="{0}")
flatten_5 = FlattenTree(Tree=sunlighthoursanalysis_4.sunlightHoursResult, Path="{0}")
lng_3 = ListLength(List=flatten(sunlighthoursanalysis_5.sunlightHoursResult))
lng_4 = ListLength(List=flatten(sunlighthoursanalysis_2.sunlightHoursResult))
r = ClusterOutput(eval)
lng_5 = ListLength(List=L_11)
lng_6 = ListLength(List=flatten(sunlighthoursanalysis_3.sunlightHoursResult))
lng_7 = ListLength(List=flatten(sunlighthoursanalysis_4.sunlightHoursResult))
lng_8 = ListLength(List=L_12)
lng_9 = ListLength(List=L_13)
lng_10 = ListLength(List=L_14)
ma_10 = MassAddition(Input=flatten_2)  # -> Result, PartialResults
ma_11 = MassAddition(Input=flatten_3)  # -> Result, PartialResults
ma_12 = MassAddition(Input=flatten_4)  # -> Result, PartialResults
ma_13 = MassAddition(Input=flatten_5)  # -> Result, PartialResults
multiplication_2 = Multiplication(A=lng_5, B=lng_4)
multiplication_3 = Multiplication(A=lng_8, B=lng_3)
multiplication_4 = Multiplication(A=lng_9, B=lng_6)
multiplication_5 = Multiplication(A=lng_10, B=lng_7)
eval_2 = Evaluate(F="x/y", x=ma_10.Result, y=multiplication_2)
eval_3 = Evaluate(F="x/y", x=ma_11.Result, y=multiplication_3)
eval_4 = Evaluate(F="x/y", x=ma_12.Result, y=multiplication_4)
eval_5 = Evaluate(F="x/y", x=ma_13.Result, y=multiplication_5)
r_2 = ClusterOutput(eval_2)
r_3 = ClusterOutput(eval_3)
r_4 = ClusterOutput(eval_5)
r_5 = ClusterOutput(eval_4)
geometry_2 = ClusterInput()
context_6 = ClusterInput()
sunvectors_6 = ClusterInput()
runit_6 = ClusterInput()
context_7 = ClusterInput()
sunvectors_7 = ClusterInput()
runit_7 = ClusterInput()
context_8 = ClusterInput()
sunvectors_8 = ClusterInput()
runit_8 = ClusterInput()
context_9 = ClusterInput()
sunvectors_9 = ClusterInput()
runit_9 = ClusterInput()
context_10 = ClusterInput()
sunvectors_10 = ClusterInput()
runit_10 = ClusterInput()
sunlighthoursanalysis_6 = Ladybug_SunlightHoursAnalysis(
    geometry=flatten(geometry_2),
    context=flatten(context_6),
    gridSize=slider,
    disFromBase=slider_2,
    sunVectors=sunvectors_6,
    timeStep=1,
    runIt=runit_6)  # -> readMe, contextMesh, analysisMesh, testPts, testVec, port, sunlightHoursResult, sunlightHoursMesh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; plug-in component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
sunlighthoursanalysis_7 = Ladybug_SunlightHoursAnalysis(
    geometry=flatten(brep),
    context=flatten(context_7),
    gridSize=slider,
    disFromBase=slider_2,
    sunVectors=sunvectors_7,
    timeStep=1,
    runIt=runit_7)  # -> readMe, contextMesh, analysisMesh, testPts, testVec, port, sunlightHoursResult, sunlightHoursMesh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; plug-in component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
sunlighthoursanalysis_8 = Ladybug_SunlightHoursAnalysis(
    geometry=flatten(brep_3),
    context=flatten(context_8),
    gridSize=slider,
    disFromBase=slider_2,
    sunVectors=sunvectors_8,
    timeStep=1,
    runIt=runit_8)  # -> readMe, contextMesh, analysisMesh, testPts, testVec, port, sunlightHoursResult, sunlightHoursMesh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; plug-in component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
sunlighthoursanalysis_9 = Ladybug_SunlightHoursAnalysis(
    geometry=flatten(brep_8),
    context=flatten(context_9),
    gridSize=slider,
    disFromBase=slider_2,
    sunVectors=sunvectors_9,
    timeStep=1,
    runIt=runit_9)  # -> readMe, contextMesh, analysisMesh, testPts, testVec, port, sunlightHoursResult, sunlightHoursMesh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; plug-in component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
sunlighthoursanalysis_10 = Ladybug_SunlightHoursAnalysis(
    geometry=flatten(brep_2),
    context=flatten(context_10),
    gridSize=slider,
    disFromBase=slider_2,
    sunVectors=sunvectors_10,
    timeStep=1,
    runIt=runit_10)  # -> readMe, contextMesh, analysisMesh, testPts, testVec, port, sunlightHoursResult, sunlightHoursMesh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; plug-in component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
L_15 = ClusterInput()
L_16 = ClusterInput()
L_17 = ClusterInput()
L_18 = ClusterInput()
L_19 = ClusterInput()
flatten_6 = FlattenTree(Tree=sunlighthoursanalysis_6.sunlightHoursResult, Path="{0}")
flatten_7 = FlattenTree(Tree=sunlighthoursanalysis_7.sunlightHoursResult, Path="{0}")
flatten_8 = FlattenTree(Tree=sunlighthoursanalysis_8.sunlightHoursResult, Path="{0}")
flatten_9 = FlattenTree(Tree=sunlighthoursanalysis_9.sunlightHoursResult, Path="{0}")
flatten_10 = FlattenTree(Tree=sunlighthoursanalysis_10.sunlightHoursResult, Path="{0}")
lng_11 = ListLength(List=flatten(sunlighthoursanalysis_6.sunlightHoursResult))
lng_12 = ListLength(List=flatten(sunlighthoursanalysis_7.sunlightHoursResult))
lng_13 = ListLength(List=L_15)
lng_14 = ListLength(List=L_16)
lng_15 = ListLength(List=flatten(sunlighthoursanalysis_8.sunlightHoursResult))
lng_16 = ListLength(List=flatten(sunlighthoursanalysis_9.sunlightHoursResult))
lng_17 = ListLength(List=flatten(sunlighthoursanalysis_10.sunlightHoursResult))
lng_18 = ListLength(List=L_17)
lng_19 = ListLength(List=L_18)
lng_20 = ListLength(List=L_19)
ma_14 = MassAddition(Input=flatten_6)  # -> Result, PartialResults
ma_15 = MassAddition(Input=flatten_7)  # -> Result, PartialResults
ma_16 = MassAddition(Input=flatten_8)  # -> Result, PartialResults
ma_17 = MassAddition(Input=flatten_9)  # -> Result, PartialResults
ma_18 = MassAddition(Input=flatten_10)  # -> Result, PartialResults
multiplication_6 = Multiplication(A=lng_13, B=lng_11)
multiplication_7 = Multiplication(A=lng_14, B=lng_12)
multiplication_8 = Multiplication(A=lng_18, B=lng_15)
multiplication_9 = Multiplication(A=lng_19, B=lng_16)
multiplication_10 = Multiplication(A=lng_20, B=lng_17)
eval_6 = Evaluate(F="x/y", x=ma_14.Result, y=multiplication_6)
eval_7 = Evaluate(F="x/y", x=ma_15.Result, y=multiplication_7)
eval_8 = Evaluate(F="x/y", x=ma_16.Result, y=multiplication_8)
eval_9 = Evaluate(F="x/y", x=ma_17.Result, y=multiplication_9)
eval_10 = Evaluate(F="x/y", x=ma_18.Result, y=multiplication_10)
r_6 = ClusterOutput(eval_6)
r_7 = ClusterOutput(eval_7)
r_8 = ClusterOutput(eval_8)
r_9 = ClusterOutput(eval_9)
r_10 = ClusterOutput(eval_10)
